# Dynamo graph ELement Creation.dyn (Dynamo 3.3.0.6316)

python_script = Python()  # CPython3; unwired: IN[0]
# ---------- python_script.python (64 lines) ----------
import clr

import sys
sys.path.append('C:\Program Files (x86)\IronPython 2.7\Lib')

import System
from System.Collections.Generic import *

clr.AddReference('ProtoGeometry')
from Autodesk.DesignScript.Geometry import *

clr.AddReference("RevitNodes")
import Revit
clr.ImportExtensions(Revit.Elements)
clr.ImportExtensions(Revit.GeometryConversion)
clr.AddReference("RevitServices")
import RevitServices
from RevitServices.Persistence import DocumentManager 
from RevitServices.Transactions import TransactionManager 

clr.AddReference("RevitAPI")
clr.AddReference("RevitAPIUI")

import Autodesk 
from Autodesk.Revit.DB import *
from Autodesk.Revit.UI import *

doc = DocumentManager.Instance.CurrentDBDocument
uiapp = DocumentManager.Instance.CurrentUIApplication 
app = uiapp.Application 
uidoc = uiapp.ActiveUIDocument

def tolist(obj1):
	if isinstance(obj1,(list, tuple, set)): return obj1
	else: return [obj1]

#Preparing input from dynamo to revit
element = UnwrapElement(IN[0])

  
levels = FilteredElementCollector(doc).OfClass(Level)

# Collect all rooms
collector = FilteredElementCollector(doc)\
            .OfCategory(BuiltInCategory.OST_Rooms)\
            .WhereElementIsNotElementType()

rooms = list(collector)

# Group rooms by level
result = []
for lvl in levels:
    lvl_id = lvl.Id
    rms = [r for r in rooms if r.LevelId == lvl_id]
    result.append(rms)
    
    
#Do some action in a Transaction

TransactionManager.Instance.EnsureInTransaction(doc)

TransactionManager.Instance.TransactionTaskDone()

OUT = result
# ----------------------------------------
code_block = CodeBlock { "Concrete Wall"; }
python_script_2 = Python(IN[0]=code_block)  # CPython3; unwired: IN[1]
# ---------- python_script_2.python (174 lines) ----------
import clr

import sys
sys.path.append('C:\Program Files (x86)\IronPython 2.7\Lib')

import System
from System.Collections.Generic import *

clr.AddReference('ProtoGeometry')
from Autodesk.DesignScript.Geometry import *

clr.AddReference("RevitNodes")
import Revit
clr.ImportExtensions(Revit.Elements)
clr.ImportExtensions(Revit.GeometryConversion)
clr.AddReference("RevitServices")
import RevitServices
from RevitServices.Persistence import DocumentManager 
from RevitServices.Transactions import TransactionManager 

clr.AddReference("RevitAPI")
clr.AddReference("RevitAPIUI")

import Autodesk 
from Autodesk.Revit.DB import *
from Autodesk.Revit.DB.Mechanical import *
from Autodesk.Revit.DB.Structure import *
from Autodesk.Revit.UI import *

doc = DocumentManager.Instance.CurrentDBDocument
uiapp = DocumentManager.Instance.CurrentUIApplication 
app = uiapp.Application 
uidoc = uiapp.ActiveUIDocument

def tolist(obj1):
	if isinstance(obj1,(list, tuple, set)): return obj1
	else: return [obj1]

#Preparing input from dynamo to revit
wallTypeName = UnwrapElement(IN[0])

#Do some action in a Transaction

"""
public static Wall Create(
    Document document,
    Curve curve,
    ElementId levelId,
    bool structural
)

public static Wall Create(
    Document document,
    Curve curve,
    ElementId wallTypeId,
    ElementId levelId,
    double height,
    double offset,
    bool flip,
    bool structural
)
"""
TransactionManager.Instance.EnsureInTransaction(doc)

wallTypes = FilteredElementCollector(doc).OfClass(WallType).ToElements()

for wallType in wallTypes:
    if wallType.LookupParameter("Type Name").AsString() == wallTypeName:
        wallTypeId = wallType.Id
        break 

levels = FilteredElementCollector(doc).OfClass(Level).ToElements()

for lvl in levels:
    if lvl.Name == "Level 0":
        lvl0Id = lvl.Id
    elif lvl.Name == "Level 1":
        lvl1Id = lvl.Id

detailLines = FilteredElementCollector(doc).OfClass(CurveElement).ToElements()
dl = detailLines[0]

curve = dl.Location.Curve
"""
wallObject = Wall.Create(doc, curve, lvl0Id, True)
wallObject.LookupParameter("Top Constraint").Set(lvl1Id)
wallObject.LookupParameter("Base Offset").Set(100/304.8)
wallObject.LookupParameter("Top Offset").Set(-250/304.8)
"""
#wallObject = Wall.Create(doc, curve, wallTypeId, lvl0Id, 3000/304.8, 0, False, True)






"""
public static Duct Create(
    Document document,
    ElementId systemTypeId,
    ElementId ductTypeId,
    ElementId levelId,
    XYZ startPoint,
    XYZ endPoint
)"""


systemTypes = FilteredElementCollector(doc).OfClass(MechanicalSystemType).ToElements()

for systemType in systemTypes:
    if systemType.LookupParameter("Type Name").AsString() == "Supply_Air":
        supplyType = systemType
        break

ductType = FilteredElementCollector(doc).OfClass(DuctType).FirstElement()


dl = detailLines[1]
line = dl.Location.Curve

startPoint = line.GetEndPoint(0)
endPoint = line.GetEndPoint(1)


#duct = Duct.Create(doc, supplyType.Id, ductType.Id, lvl0Id, startPoint, endPoint)
#duct.LookupParameter("Middle Elevation").Set(1000/304.8)












"""
public FamilyInstance NewFamilyInstance(
    XYZ location,
    FamilySymbol symbol,
    StructuralType structuralType
)"""


loc = XYZ(3000/304.8,3000/304.8,0)


fs = FilteredElementCollector(doc).OfClass(FamilySymbol).ToElements()

furnitureTypes = FilteredElementCollector(doc).OfCategory(BuiltInCategory.OST_Furniture).WhereElementIsElementType().ToElements()


for ft in furnitureTypes:
    if ft.LookupParameter("Type Name").AsString() == "1830x915mm": 
        desk = ft
        break

if desk.IsActive == False:
    desk.Activate()

furniture = doc.Create.NewFamilyInstance(loc, desk, StructuralType.NonStructural)








TransactionManager.Instance.TransactionTaskDone()

OUT = desk.IsActive
# ----------------------------------------
byCoordinates = Point.ByCoordinates()
