# Dynamo graph Element modification.dyn (Dynamo 3.3.0.6316)

python_script = Python()  # CPython3; unwired: IN[0]
# ---------- python_script.python (96 lines) ----------
import clr

import sys
sys.path.append('C:\Program Files (x86)\IronPython 2.7\Lib')

import System
from System.Collections.Generic import *

clr.AddReference('ProtoGeometry')
from Autodesk.DesignScript.Geometry import *

clr.AddReference("RevitNodes")
import Revit
clr.ImportExtensions(Revit.Elements)
clr.ImportExtensions(Revit.GeometryConversion)
clr.AddReference("RevitServices")
import RevitServices
from RevitServices.Persistence import DocumentManager 
from RevitServices.Transactions import TransactionManager 

clr.AddReference("RevitAPI")
clr.AddReference("RevitAPIUI")

import Autodesk 
from Autodesk.Revit.DB import *
from Autodesk.Revit.UI import *

doc = DocumentManager.Instance.CurrentDBDocument
uiapp = DocumentManager.Instance.CurrentUIApplication 
app = uiapp.Application 
uidoc = uiapp.ActiveUIDocument

def tolist(obj1):
	if isinstance(obj1,(list, tuple, set)): return obj1
	else: return [obj1]

#Preparing input from dynamo to revit
ele = UnwrapElement(IN[0])

#Do some action in a Transaction

TransactionManager.Instance.EnsureInTransaction(doc)
"""
detailLine = FilteredElementCollector(doc).OfClass(CurveElement).FirstElement()
curve = detailLine.Location.Curve

wallTypes = FilteredElementCollector(doc).OfClass(WallType).ToElements()
for wallType in wallTypes:
    if wallType.LookupParameter("Type Name").AsString() == "CMU Wall":
        wallTypeID = wallType.Id
        break

levels = FilteredElementCollector(doc).OfClass(Level).ToElements()
for level in levels:
    if level.Name == "Level 0":
        levelID = level.Id
        break

theWall = Wall.Create(doc, curve, wallTypeID, levelID, 2500/304.8, 0, False, False)

midPoint = curve.Evaluate(0.5, True)

doorTypes = FilteredElementCollector(doc).OfCategory(BuiltInCategory.OST_Doors).WhereElementIsElementType().ToElements()
for doorType in doorTypes:
    if doorType.LookupParameter("Type Name").AsString() == "1810x2110mm":
        TypeOfDoor = doorType 

door = doc.Create.NewFamilyInstance(midPoint, TypeOfDoor, theWall, StructuralType.NonStructural)


sp = XYZ()
ep = XYZ(10,0,0)
line = Line.CreateBound(sp, ep)

typecabletray_types=FilteredElementCollector(doc).OfClass(CableTrayType).ToElements()
cabletray_type=cabletray_types[0]
#get level
levels=FilteredElementCollector(doc).OfClass(Level).ToElements()
for level in levels:    
    if level.Name=="Level 2":        
        levelid=level        
        break
#get detail line
detail_lines=FilteredElementCollector(doc).OfClass(CurveElement).ToElements()
detail_line=detail_lines[0]
dl=detail_line.GeometryCurve
startpoint=dl.GetEndPoint(0)
endpoint=dl.GetEndPoint(1)
cabletray=CableTray.Create(doc,cabletray_type.Id,startpoint,endpoint,level.Id)
"""



TransactionManager.Instance.TransactionTaskDone()

OUT = "5\' 12\""
# ----------------------------------------
select_model_element = DSModelElementSelection()  # 1 picked in the model
select_model_element_2 = DSModelElementSelection()  # 1 picked in the model
python_script_2 = Python(IN[0]=select_model_element, IN[1]=select_model_element_2)  # CPython3
# ---------- python_script_2.python (139 lines) ----------
import clr

import sys
sys.path.append('C:\Program Files (x86)\IronPython 2.7\Lib')

import System
from System.Collections.Generic import *

clr.AddReference('ProtoGeometry')
from Autodesk.DesignScript.Geometry import *

clr.AddReference("RevitNodes")
import Revit
clr.ImportExtensions(Revit.Elements)
clr.ImportExtensions(Revit.GeometryConversion)
clr.AddReference("RevitServices")
import RevitServices
from RevitServices.Persistence import DocumentManager 
from RevitServices.Transactions import TransactionManager 

clr.AddReference("RevitAPI")
clr.AddReference("RevitAPIUI")

import Autodesk 
from Autodesk.Revit.DB import *
from Autodesk.Revit.UI import *

doc = DocumentManager.Instance.CurrentDBDocument
uiapp = DocumentManager.Instance.CurrentUIApplication 
app = uiapp.Application 
uidoc = uiapp.ActiveUIDocument

def tolist(obj1):
	if isinstance(obj1,(list, tuple, set)): return obj1
	else: return [obj1]

#Preparing input from dynamo to revit
dl = UnwrapElement(IN[0])
duct = UnwrapElement(IN[1])

#Do some action in a Transaction


TransactionManager.Instance.EnsureInTransaction(doc)

"""
Delete elements
walls = FilteredElementCollector(doc).OfClass(Wall).ToElements()

for wall in walls:
    doc.Delete(wall.Id)
"""


furnitures = FilteredElementCollector(doc).OfCategory(BuiltInCategory.OST_Furniture).WhereElementIsNotElementType().ToElements()

for furn in furnitures:
    if furn.LookupParameter("Mark").AsString() == "Test":
        ele = furn
        break

"""
public static ICollection<ElementId> CopyElement(
    Document document,
    ElementId elementToCopy,
    XYZ translation
)"""

trans = XYZ(-3000/304.8, 7000/304.8, 0)

xValues = range(3000,9001,3000)

for x in xValues:
    trans = XYZ(x/304.8, 0, 0) 
    #ElementTransformUtils.CopyElement(doc, ele.Id, trans)

"""
public static void MoveElement(
    Document document,
    ElementId elementToMove,
    XYZ translation
)"""


trans = XYZ(5000/304.8, 5000/304.8, 0)
#ElementTransformUtils.MoveElement(doc, ele.Id, trans)


#cp = dl.Location.Curve.Center
#ele.Location.Point = cp


#newCurve = dl.Location.Curve
#duct.Location.Curve = newCurve


val = ele.Pinned
#ele.Pinned = True

"""
public static void RotateElement(
    Document document,
    ElementId elementToRotate,
    Line axis,
    double angle
)"""


cp = ele.Location.Point
tp = XYZ(cp.X, cp.Y, cp.Z+10)

axis = Line.CreateBound(cp, tp)

#ElementTransformUtils.RotateElement(doc, ele.Id, axis, 0.523599)


"""
public static void MirrorElement(
    Document document,
    ElementId elementToMirror,
    Plane plane
)
public static Plane CreateByNormalAndOrigin(
    XYZ normal,
    XYZ origin
)
"""


xAxis = XYZ(1,0,0)
plane = Plane.CreateByNormalAndOrigin(xAxis, dl.Location.Curve.GetEndPoint(0))


ElementTransformUtils.MirrorElement(doc, ele.Id, plane)


TransactionManager.Instance.TransactionTaskDone()

OUT = plane
# ----------------------------------------
XAxis = Vector.XAxis()
