# Dynamo graph FEC.dyn (Dynamo 3.3.0.6316)

python_script = Python()  # CPython3; frozen; unwired: IN[0]
# ---------- python_script.python (68 lines) ----------
import clr

import sys
sys.path.append('C:\Program Files (x86)\IronPython 2.7\Lib')

import System
from System.Collections.Generic import *

clr.AddReference('ProtoGeometry')
from Autodesk.DesignScript.Geometry import *

clr.AddReference("RevitNodes")
import Revit
clr.ImportExtensions(Revit.Elements)
clr.ImportExtensions(Revit.GeometryConversion)
clr.AddReference("RevitServices")
import RevitServices
from RevitServices.Persistence import DocumentManager 
from RevitServices.Transactions import TransactionManager 

clr.AddReference("RevitAPI")
clr.AddReference("RevitAPIUI")

import Autodesk 
from Autodesk.Revit.DB import *
from Autodesk.Revit.UI import *

doc = DocumentManager.Instance.CurrentDBDocument
uiapp = DocumentManager.Instance.CurrentUIApplication 
app = uiapp.Application 
uidoc = uiapp.ActiveUIDocument

def tolist(obj1):
	if isinstance(obj1,(list, tuple, set)): return obj1
	else: return [obj1]

#Preparing input from dynamo to revit
element = UnwrapElement(IN[0])

#Do some action in a Transaction

levels = FilteredElementCollector(doc).OfCategory(BuiltInCategory.OST_Levels).WhereElementIsNotElementType()

walls = FilteredElementCollector(doc).OfCategory(BuiltInCategory.OST_Walls).WhereElementIsNotElementType()

lvlname = []
for lvl in levels:
    lname = lvl.Name
    lvlname.append(lname)

#keyword = UnwrapElement(IN[1])
#replace = UnwrapElement(IN[2])

TransactionManager.Instance.EnsureInTransaction(doc)

result = []
for wall in walls:
    walparameter = wall.LookupParameter("Mark").AsString()
    if "have" in walparameter:
        wallpara = wall.LookupParameter("Mark")
        wallpara.Set("had")
        result.append(wall)
 
        
TransactionManager.Instance.TransactionTaskDone()


OUT = result
# ----------------------------------------
python_script_2 = Python()  # CPython3; unwired: IN[0]
# ---------- python_script_2.python (118 lines) ----------
import clr

import sys
sys.path.append('C:\Program Files (x86)\IronPython 2.7\Lib')

import System
from System.Collections.Generic import *

clr.AddReference('ProtoGeometry')
from Autodesk.DesignScript.Geometry import *

clr.AddReference("RevitNodes")
import Revit
clr.ImportExtensions(Revit.Elements)
clr.ImportExtensions(Revit.GeometryConversion)
clr.AddReference("RevitServices")
import RevitServices
from RevitServices.Persistence import DocumentManager 
from RevitServices.Transactions import TransactionManager 

clr.AddReference("RevitAPI")
clr.AddReference("RevitAPIUI")

import Autodesk 
from Autodesk.Revit.DB import *
from Autodesk.Revit.UI import *

doc = DocumentManager.Instance.CurrentDBDocument
uiapp = DocumentManager.Instance.CurrentUIApplication 
app = uiapp.Application 
uidoc = uiapp.ActiveUIDocument

def tolist(obj1):
	if isinstance(obj1,(list, tuple, set)): return obj1
	else: return [obj1]

#Preparing input from dynamo to revit
element = UnwrapElement(IN[0])

#Do some action in a Transaction

elements = FilteredElementCollector(doc).OfCategory(BuiltInCategory.OST_Walls).ToElements()

elements2 = FilteredElementCollector(doc).OfCategory(BuiltInCategory.OST_CableTray).ToElements()

TransactionManager.Instance.EnsureInTransaction(doc)

#catList = [BuiltInCategory.OST_Walls, BuiltInCategory.OST_CableTray ]

catList = List[BuiltInCategory]()
catList.Add(BuiltInCategory.OST_Walls)
catList.Add(BuiltInCategory.OST_CableTray)

catFilter =  ElementMulticategoryFilter(catList)

fec = FilteredElementCollector(doc).WherePasses(catFilter).WhereElementIsNotElementType().ToElements()


fec2 = FilteredElementCollector(doc).WherePasses(ElementIsCurveDrivenFilter()).ToElements()


allLevels = FilteredElementCollector(doc).OfClass(Level).ToElements()
for level in allLevels:
    if level.Name == "Level 0":
        level0 = level
        break

result = []

for ele in fec:
    levelId = ele.LevelId
    if levelId == level0.Id:
        result.append(ele)
























catList = List[BuiltInCategory]()
catList.Add(BuiltInCategory.OST_Walls)
catList.Add(BuiltInCategory.OST_CableTray)
catList.Add(BuiltInCategory.OST_DuctCurves)

catFilter =  ElementMulticategoryFilter(catList)

allLevels = FilteredElementCollector(doc).OfClass(Level).ToElements()
for level in allLevels:
    if level.Name == "Level 0":
        level0 = level
        break

levelFilter = ElementLevelFilter(level0.Id)

wallsAndCtsInLevel0 = FilteredElementCollector(doc).WherePasses(levelFilter).WherePasses(catFilter).ToElements()


TransactionManager.Instance.TransactionTaskDone()

OUT = wallsAndCtsInLevel0
# ----------------------------------------
