# Dynamo graph FEC2.dyn (Dynamo 3.3.0.6316)

python_script = Python()  # CPython3; unwired: IN[0]
# ---------- python_script.python (124 lines) ----------
import clr

import sys
sys.path.append('C:\Program Files (x86)\IronPython 2.7\Lib')

from System import *
from System.Collections.Generic import *

clr.AddReference('ProtoGeometry')
from Autodesk.DesignScript.Geometry import *

clr.AddReference("RevitNodes")
import Revit
clr.ImportExtensions(Revit.Elements)
clr.ImportExtensions(Revit.GeometryConversion)
clr.AddReference("RevitServices")
import RevitServices
from RevitServices.Persistence import DocumentManager 
from RevitServices.Transactions import TransactionManager 

clr.AddReference("RevitAPI")
clr.AddReference("RevitAPIUI")

import Autodesk 
from Autodesk.Revit.DB import *
from Autodesk.Revit.DB.Electrical import *
from Autodesk.Revit.DB.Mechanical import *
from Autodesk.Revit.UI import *

doc = DocumentManager.Instance.CurrentDBDocument
uiapp = DocumentManager.Instance.CurrentUIApplication 
app = uiapp.Application 
uidoc = uiapp.ActiveUIDocument

def tolist(obj1):
	if isinstance(obj1,(list, tuple, set)): return obj1
	else: return [obj1]

#Preparing input from dynamo to revit
element = UnwrapElement(IN[0])

#Do some action in a Transaction

TransactionManager.Instance.EnsureInTransaction(doc)

#ElementMulticategoryFilter accepts i colection(C#)list as Input
#syntax is List[datatype]()
catList = List[BuiltInCategory]()
catList.Add(BuiltInCategory.OST_Walls) 
catList.Add(BuiltInCategory.OST_Floors)
collec = ElementMulticategoryFilter(catList)
levels = FilteredElementCollector(doc).OfClass(Level) #Collecting and Filtereing levels to get the required levelId
for level in levels:
    if level.Name == "Level 0":
        level_3     =level
        level_0_ID  =level_3.Id
        break
# collecting Elements corresponding to the levels in the model or document using ElementLevelFilter Class
levelElem = ElementLevelFilter(level_0_ID)
fec = FilteredElementCollector(doc).WherePasses(collec).WherePasses(levelElem).WhereElementIsNotElementType().ToElements()


classList = List[Type]()
classList.Add(Wall)
classList.Add(CableTray)
classList.Add(Duct)

classFilter = ElementMulticlassFilter(classList) 

fec = FilteredElementCollector(doc).WherePasses(classFilter).ToElements()


typelist=List[Type]()
typelist.Add(Wall)
typelist.Add(Duct)
typelist.Add(CableTray)
typelist.Add(FamilyInstance)
multiclassfilter=ElementMulticlassFilter(typelist)
fec=FilteredElementCollector(doc).WherePasses(multiclassfilter).WhereElementIsNotElementType().ToElements()















catList = List[BuiltInCategory]()
catList.Add(BuiltInCategory.OST_Walls) 
collec = ElementMulticategoryFilter(catList, True)


levelFilter = ElementLevelFilter(level_0_ID)


filterList = List[ElementFilter]()
filterList.Add(collec)
filterList.Add(levelFilter)

orFilter = LogicalAndFilter(filterList)


fec = FilteredElementCollector(doc).WherePasses(orFilter).WhereElementIsNotElementType().ToElements()


viewId = doc.ActiveView.Id

fecView = FilteredElementCollector(doc, viewId).WherePasses(collec)






TransactionManager.Instance.TransactionTaskDone()

OUT = fecView
# ----------------------------------------
select_model_element = DSModelElementSelection()  # 1 picked in the model
getLocation = Element.GetLocation(element=select_model_element)
python_script_2 = Python(IN[0]=select_model_element, IN[1]=getLocation)  # CPython3
# ---------- python_script_2.python (56 lines) ----------
import clr

import sys
sys.path.append('C:\Program Files (x86)\IronPython 2.7\Lib')

import System
from System.Collections.Generic import *

clr.AddReference('ProtoGeometry')
from Autodesk.DesignScript.Geometry import *

clr.AddReference("RevitNodes")
import Revit
clr.ImportExtensions(Revit.Elements)
clr.ImportExtensions(Revit.GeometryConversion)
clr.AddReference("RevitServices")
import RevitServices
from RevitServices.Persistence import DocumentManager 
from RevitServices.Transactions import TransactionManager 

clr.AddReference("RevitAPI")
clr.AddReference("RevitAPIUI")

import Autodesk 
from Autodesk.Revit.DB import *
from Autodesk.Revit.UI import *

doc = DocumentManager.Instance.CurrentDBDocument
uiapp = DocumentManager.Instance.CurrentUIApplication 
app = uiapp.Application 
uidoc = uiapp.ActiveUIDocument

def tolist(obj1):
	if isinstance(obj1,(list, tuple, set)): return obj1
	else: return [obj1]

#Preparing input from dynamo to revit
element = UnwrapElement(IN[0])
dyn = UnwrapElement(IN[1])

#Do some action in a Transaction

#Dyn point to Revit Point -> ToXyz()
#Dyn Line to Revit api line -> ToRevitType()


#Revit Point to Dyn Point -> ToPoint()
#Revit Line to Dyn Line -> ToProtoType()



TransactionManager.Instance.EnsureInTransaction(doc)

TransactionManager.Instance.TransactionTaskDone()

OUT = element.LookupParameter("Reference Level").AsElementId()
# ----------------------------------------
byCoordinates = Point.ByCoordinates()
