# Dynamo graph Parameters.dyn (Dynamo 3.0.3.7597)

select_model_element = DSModelElementSelection()  # 1 picked in the model
levels = Levels("Level 0")
python_script = Python(IN[0]=select_model_element, IN[1]=levels)  # CPython3
# ---------- python_script.python (256 lines) ----------
import clr

import sys
sys.path.append('C:\Program Files (x86)\IronPython 2.7\Lib')

import System
from System.Collections.Generic import *

clr.AddReference('ProtoGeometry')
from Autodesk.DesignScript.Geometry import *

clr.AddReference("RevitNodes")
import Revit
clr.ImportExtensions(Revit.Elements)
clr.ImportExtensions(Revit.GeometryConversion)
clr.AddReference("RevitServices")
import RevitServices
from RevitServices.Persistence import DocumentManager 
from RevitServices.Transactions import TransactionManager 

clr.AddReference("RevitAPI")
clr.AddReference("RevitAPIUI")

import Autodesk 
from Autodesk.Revit.DB import *
from Autodesk.Revit.UI import *

doc = DocumentManager.Instance.CurrentDBDocument
uiapp = DocumentManager.Instance.CurrentUIApplication 
app = uiapp.Application 
uidoc = uiapp.ActiveUIDocument

def tolist(obj1):
	if isinstance(obj1,(list, tuple, set)): return obj1
	else: return [obj1]

#Preparing input from dynamo to revit
#element = UnwrapElement(IN[0])

#Do some action in a Transaction










































"""




TransactionManager.Instance.EnsureInTransaction(doc)

paramList = []

for wall in wallList:
    parameter = wall.LookupParameter("Base Constraint")
    paramValue = parameter.AsElementId() #.AsDouble()*0.092903
    #boolValue = bool(paramValue)
    paramList.append(paramValue)


TransactionManager.Instance.TransactionTaskDone()

level = doc.GetElement(paramList[0])
"""












"""

wallList = tolist(UnwrapElement(IN[0]))

levelElevations = []

for wall in wallList:
    baseParam = wall.LookupParameter("Base Constraint").AsElementId()
    level = doc.GetElement(baseParam)
    levelEle = level.LookupParameter("Elevation").AsDouble()*304.8
    levelElevations.append(levelEle)
"""



"""
beams = tolist(UnwrapElement(IN[0]))

referenceLevelName = []
referenceLevelElevation = []

for beam in beams:
    levelID = beam.LookupParameter("Reference Level").AsElementId()
    level = doc.GetElement(levelID)
    referenceLevelName.append(level.Name)
    referenceLevelElevation.append(level.Elevation)

list = zip(referenceLevelName, referenceLevelElevation)



walls = tolist(UnwrapElement(IN[0]))


LevelNamelist= []
LevelElevationlist = []

for wall in walls:
    LevelID = wall.LookupParameter("Base Constraint").AsElementId()
    level = doc.GetElement(LevelID)
    LevelNamelist.append(level.Name)
    LevelElevationlist.append((level.Elevation)*304.8)

result  = LevelNamelist,LevelElevationlist
transpose = [list(i) for i in zip(*result)]




walls = tolist(UnwrapElement(IN[0]))
levelValue = []
for ele in walls:
    base = ele.LookupParameter("Base Constraint").AsElementId()
    level = doc.GetElement(base)
    levelname = level.Name
    levelval = level.Elevation*304.8
    result = [levelname,levelval]
    levelValue.append(result)   



wall = UnwrapElement(IN[0])



param = wall.LookupParameter("Comments").AsString()


param2 = wall.get_Parameter(BuiltInParameter.ALL_MODEL_INSTANCE_COMMENTS).AsString()

#enums
#enumeration

workset = wall.get_Parameter(BuiltInParameter.ELEM_PARTITION_PARAM).AsElementId()

"""






























wall = UnwrapElement(IN[0])
level = UnwrapElement(IN[1])

TransactionManager.Instance.EnsureInTransaction(doc)

param = wall.LookupParameter("Comments")

#levelElementId = level.Id

#param.Set(level.Id)

#eleId = ElementId(314805)

#param.Set(eleId)

#param.Set(100/304.8)

#result = param.Set(1)

#result = param.Set("I'm Batman")


wallTypeId = wall.GetTypeId()
wallType = doc.GetElement(wallTypeId)

typeCommsParam = wallType.LookupParameter("Type Comments").AsString()


typeComm = wallType.LookupParameter("Type Comments")
#.Set("Spider Man")


TransactionManager.Instance.TransactionTaskDone()


OUT = typeComm.Set("Parasant")
# ----------------------------------------
code_block = CodeBlock { "Comments"; }
getParameterValueByName = Element.GetParameterValueByName(element=select_model_element, parameterName=code_block)
select_model_elements = DSModelElementsSelection()  # 2 picked in the model
levels_2 = Levels("Level 0")
code_block_2 = CodeBlock { "Testinggggg"; }
setParameterByName = Element.SetParameterByName(element=select_model_element, parameterName=code_block, value=code_block_2)  # frozen
elementType = Element.ElementType(element=select_model_element)
code_block_3 = CodeBlock { "Type Comments"; }
getParameterValueByName_2 = Element.GetParameterValueByName(element=elementType, parameterName=code_block_3)
