# Dynamo graph Unwrap, tolist, transaction.dyn (Dynamo 3.0.3.7597)

python_script = Python()  # CPython3; frozen; unwired: IN[0]
# ---------- python_script.python (98 lines) ----------
import clr

"""
import sys
sys.path.append('C:\Program Files (x86)\IronPython 2.7\Lib')
"""

import System
from System.Collections.Generic import *

clr.AddReference('ProtoGeometry')
from Autodesk.DesignScript.Geometry import *

clr.AddReference("RevitNodes")
import Revit
clr.ImportExtensions(Revit.Elements)
clr.ImportExtensions(Revit.GeometryConversion)
clr.AddReference("RevitServices")
import RevitServices
from RevitServices.Persistence import DocumentManager 
from RevitServices.Transactions import TransactionManager 

clr.AddReference("RevitAPI")
clr.AddReference("RevitAPIUI")

import Autodesk 
from Autodesk.Revit.DB import *
from Autodesk.Revit.UI import *

doc = DocumentManager.Instance.CurrentDBDocument
uiapp = DocumentManager.Instance.CurrentUIApplication 
app = uiapp.Application 
uidoc = uiapp.ActiveUIDocument

def tolist(obj1): 
    if isinstance(obj1, (list, tuple, set, str)):
        return obj1
    else:
        return [obj1]

#Preparing input from dynamo to revit
#element = UnwrapElement(IN[0])

#Do some action in a Transaction

TransactionManager.Instance.EnsureInTransaction(doc)



TransactionManager.Instance.TransactionTaskDone()





























"""
wallList = tolist(UnwrapElement(IN[0]))


wallNames = []

for wall in wallList: 
    name = wall.Name
    wallNames.append(name)
 
"""
 

wall = UnwrapElement(IN[0])

wall.Pinned = False


OUT = ""
# ----------------------------------------
code_block = CodeBlock { 123456; "abc"; [7,8,9]; }
select_model_element = DSModelElementSelection()  # 1 picked in the model
select_model_elements = DSModelElementsSelection()  # 2 picked in the model
name = Element.Name(element=select_model_elements)
python_script_2 = Python(IN[0]=select_model_elements)  # CPython3
# ---------- python_script_2.python (56 lines) ----------
import clr

import sys
sys.path.append('C:\Program Files (x86)\IronPython 2.7\Lib')

import System
from System.Collections.Generic import *

clr.AddReference('ProtoGeometry')
from Autodesk.DesignScript.Geometry import *

clr.AddReference("RevitNodes")
import Revit
clr.ImportExtensions(Revit.Elements)
clr.ImportExtensions(Revit.GeometryConversion)
clr.AddReference("RevitServices")
import RevitServices
from RevitServices.Persistence import DocumentManager 
from RevitServices.Transactions import TransactionManager 

clr.AddReference("RevitAPI")
clr.AddReference("RevitAPIUI")

import Autodesk 
from Autodesk.Revit.DB import *
from Autodesk.Revit.UI import *

doc = DocumentManager.Instance.CurrentDBDocument
uiapp = DocumentManager.Instance.CurrentUIApplication 
app = uiapp.Application 
uidoc = uiapp.ActiveUIDocument

def tolist(obj1):
    if isinstance(obj1, (list, tuple, set, str)):return obj1
    else: return [obj1]

#Preparing input from dynamo to revit
wallList = tolist(UnwrapElement(IN[0]))

#Do some action in a Transaction


TransactionManager.Instance.EnsureInTransaction(doc)

wallNames = []

for wall in wallList:
    #wall.Pinned = True
    wallNames.append(wall.Name)


TransactionManager.Instance.TransactionTaskDone()



OUT = wallNames
# ----------------------------------------
setParameterByName = Element.SetParameterByName()  # unwired: element, parameterName, value
setParameterByName_2 = Element.SetParameterByName()  # unwired: element, parameterName, value
setParameterByName_3 = Element.SetParameterByName()  # unwired: element, parameterName, value
