# Dynamo graph Views.dyn (Dynamo 3.3.0.6316)

select_model_elements = DSModelElementsSelection()  # 6 picked in the model
select_model_element = DSModelElementSelection()  # 1 picked in the model
python_script = Python(IN[0]=select_model_elements, IN[1]=select_model_element)  # CPython3; frozen
# ---------- python_script.python (114 lines) ----------
import clr

import sys
sys.path.append('C:\Program Files (x86)\IronPython 2.7\Lib')

import System
from System.Collections.Generic import *

clr.AddReference('ProtoGeometry')
from Autodesk.DesignScript.Geometry import *

clr.AddReference("RevitNodes")
import Revit
clr.ImportExtensions(Revit.Elements)
clr.ImportExtensions(Revit.GeometryConversion)
clr.AddReference("RevitServices")
import RevitServices
from RevitServices.Persistence import DocumentManager 
from RevitServices.Transactions import TransactionManager 

clr.AddReference("RevitAPI")
clr.AddReference("RevitAPIUI")

import Autodesk 
from Autodesk.Revit.DB import *
from Autodesk.Revit.UI import *

doc = DocumentManager.Instance.CurrentDBDocument
uiapp = DocumentManager.Instance.CurrentUIApplication 
app = uiapp.Application 
uidoc = uiapp.ActiveUIDocument

def tolist(obj1):
	if isinstance(obj1,(list, tuple, set)): return obj1
	else: return [obj1]

#element = UnwrapElement(IN[0])
dl = tolist(UnwrapElement(IN[0]))
fr = UnwrapElement(IN[1])

#Do some action in a Transaction

TransactionManager.Instance.EnsureInTransaction(doc)
"""
public static Wall Create(
    Document document,
    IList<Curve> profile,
    ElementId wallTypeId,
    ElementId levelId,
    bool structural
)
"""
walltyp = FilteredElementCollector(doc).OfClass(WallType).ToElements()

level = FilteredElementCollector(doc).OfClass(Level).ToElements()

#detailLine = FilteredElementCollector(doc).OfClass(CurveElement)#.ToElements()

for lvl in level:
    if lvl.Name == "Level 0":
        lvlid = lvl.Id
        break


for id in walltyp:
    if id.LookupParameter("Type Name").AsString() == "Wall-Ret_300Con":
        walltypid = id.Id
        break 

for crve in dl:
    curve = crve.Location.Curve
    #wall = Wall.Create(doc, curve, lvlid, True)

"""
public static Wall Create(
    Document document,
    IList<Curve> profile,
    ElementId wallTypeId,
    ElementId levelId,
    bool structural
)"""


cl = List[Curve]()
for i in list(fr.GetBoundaries()):
    for j in i:
        cl.Add(j)


newProfileWall = Wall.Create(doc, cl , walltyp[0].Id, lvlid, True)



"""
for crve in dl:
    curve = crve.Location.Curve
    curveList.append(curve)
#ccurveList = List[Curve](curveList)

  

#curve = dl.Location.Curve

i = 0

while i <= (len(curveList)-1):
    wall = Wall.Create(doc, curveList[i], lvlid, False)
    i += 1

#wall = Wall.Create(doc, curve, walltypid, lvlid, True)
"""
TransactionManager.Instance.TransactionTaskDone()

OUT = fr.GetBoundaries()
# ----------------------------------------
python_script_2 = Python()  # CPython3; frozen; unwired: IN[0]
# ---------- python_script_2.python (108 lines) ----------
import clr

import sys
sys.path.append('C:\Program Files (x86)\IronPython 2.7\Lib')

import System
from System.Collections.Generic import *

clr.AddReference('ProtoGeometry')
from Autodesk.DesignScript.Geometry import *

clr.AddReference("RevitNodes")
import Revit
clr.ImportExtensions(Revit.Elements)
clr.ImportExtensions(Revit.GeometryConversion)
clr.AddReference("RevitServices")
import RevitServices
from RevitServices.Persistence import DocumentManager 
from RevitServices.Transactions import TransactionManager 

clr.AddReference("RevitAPI")
clr.AddReference("RevitAPIUI")

import Autodesk 
from Autodesk.Revit.DB import *
from Autodesk.Revit.UI import *

doc = DocumentManager.Instance.CurrentDBDocument
uiapp = DocumentManager.Instance.CurrentUIApplication 
app = uiapp.Application 
uidoc = uiapp.ActiveUIDocument

def tolist(obj1):
	if isinstance(obj1,(list, tuple, set)): return obj1
	else: return [obj1]

#Preparing input from dynamo to revit
element = UnwrapElement(IN[0])

#Do some action in a Transaction

TransactionManager.Instance.EnsureInTransaction(doc)


views = FilteredElementCollector(doc).OfCategory(BuiltInCategory.OST_Views).WhereElementIsNotElementType().ToElements()


temp = []
for i in views:
    if not i.IsTemplate:
        temp.append(i.Name)


from collections import defaultdict

views = FilteredElementCollector(doc) \
    .OfCategory(BuiltInCategory.OST_Views) \
    .WhereElementIsNotElementType() \
    .ToElements()

# Dictionary: {ViewType: [sorted names]}
grouped_views = defaultdict(list)

for v in views:
    grouped_views[v.ViewType].append(v.Name)

# Sort names inside each group
for vt in grouped_views:
    grouped_views[vt].sort()


collection = [i.Name for i in views if i.IsTemplate]

"""
public static ViewPlan Create(
    Document document,
    ElementId viewFamilyTypeId,
    ElementId levelId
)"""

level = FilteredElementCollector(doc).OfClass(Level).FirstElement()

vfts = FilteredElementCollector(doc).OfClass(ViewFamilyType).ToElements()
floopPlanType = [i for i in vfts if i.LookupParameter("Type Name").AsString() == "Floor Plan"][0]

#newFloorPlan = ViewPlan.Create(doc, floopPlanType.Id, level.Id)
#newFloorPlan.Name = "Abdul View"

"""
public static ViewSheet Create(
    Document document,
    ElementId titleBlockTypeId
)"""


tbt = FilteredElementCollector(doc).OfCategory(BuiltInCategory.OST_TitleBlocks).WhereElementIsElementType().FirstElement()


#newSheet = ViewSheet.Create(doc, tbt.Id)
#newSheet.Name = "Karthick"
#newSheet.SheetNumber = "007"

viewNames = [i.Name for i in views]
viewNames.sort()

TransactionManager.Instance.TransactionTaskDone()

OUT = grouped_views
# ----------------------------------------
python_script_3 = Python()  # CPython3; unwired: IN[0]
# ---------- python_script_3.python (42 lines) ----------
# Dynamo Python script (Revit API)

import clr
clr.AddReference('RevitServices')
from RevitServices.Persistence import DocumentManager
from RevitServices.Transactions import TransactionManager

clr.AddReference('RevitAPI')
from Autodesk.Revit.DB import *

from collections import defaultdict

doc = DocumentManager.Instance.CurrentDBDocument

# Collect all views
views = FilteredElementCollector(doc) \
    .OfCategory(BuiltInCategory.OST_Views) \
    .WhereElementIsNotElementType() \
    .ToElements()

# OPTIONAL but recommended: remove templates
views = [v for v in views if not v.IsTemplate]

# Group views by ViewType
grouped_views = defaultdict(list)

for v in views:
    grouped_views[v.ViewType].append(v.Name)

# Sort names inside each group
for vt in grouped_views:
    grouped_views[vt].sort()

# Convert to Dynamo-friendly output (lists instead of dict)
viewTypes = []
namesGrouped = []

for vt in sorted(grouped_views.keys(), key=lambda x: str(x)):
    viewTypes.append(str(vt))
    namesGrouped.append(grouped_views[vt])

OUT = viewTypes, namesGrouped
# ----------------------------------------
python_script_4 = Python()  # CPython3; frozen; unwired: IN[0]
# ---------- python_script_4.python (87 lines) ----------
import clr

import sys
sys.path.append('C:\Program Files (x86)\IronPython 2.7\Lib')

import System
from System.Collections.Generic import *

clr.AddReference('ProtoGeometry')
from Autodesk.DesignScript.Geometry import *

clr.AddReference("RevitNodes")
import Revit
clr.ImportExtensions(Revit.Elements)
clr.ImportExtensions(Revit.GeometryConversion)
clr.AddReference("RevitServices")
import RevitServices
from RevitServices.Persistence import DocumentManager 
from RevitServices.Transactions import TransactionManager 

clr.AddReference("RevitAPI")
clr.AddReference("RevitAPIUI")

import Autodesk 
from Autodesk.Revit.DB import *
from Autodesk.Revit.UI import *

doc = DocumentManager.Instance.CurrentDBDocument
uiapp = DocumentManager.Instance.CurrentUIApplication 
app = uiapp.Application 
uidoc = uiapp.ActiveUIDocument

def tolist(obj1):
	if isinstance(obj1,(list, tuple, set)): return obj1
	else: return [obj1]

#Preparing input from dynamo to revit
element = UnwrapElement(IN[0])

#Do some action in a Transaction

TransactionManager.Instance.EnsureInTransaction(doc)


"""public static Viewport Create(
    Document document,
    ElementId viewSheetId,
    ElementId viewId,
    XYZ point
)"""


sheets = FilteredElementCollector(doc).OfClass(ViewSheet).ToElements()
karthickSheet = [i for i in sheets if i.Name == "Karthick"][0]


views = FilteredElementCollector(doc).OfClass(View).ToElements()
abdulView = [i for i in views if i.Name == "Abdul View"][0]


ot = karthickSheet.Outline
min = ot.Min
max = ot.Max

xDist = max.U - min.U
yDist = max.V - min.V

pt = XYZ(xDist/2, yDist/2,0)

#vp = Viewport.Create(doc, karthickSheet.Id, abdulView.Id, pt)


sheets = FilteredElementCollector(doc).OfClass(ViewSheet).ToElements()
views = FilteredElementCollector(doc).OfClass(View).ToElements()


for sheet in sheets:
    for view in views:
        if sheet.SheetNumber == view.Name:
            vp = Viewport.Create(doc, sheet.Id, view.Id, pt)




TransactionManager.Instance.TransactionTaskDone()

OUT = min, max
# ----------------------------------------
select_model_elements_2 = DSModelElementsSelection()  # 12 picked in the model
select_model_element_2 = DSModelElementSelection()  # 1 picked in the model
python_script_5 = Python(IN[0]=select_model_elements_2, IN[1]=select_model_element_2)  # CPython3
# ---------- python_script_5.python (78 lines) ----------
import clr

import sys
sys.path.append('C:\Program Files (x86)\IronPython 2.7\Lib')

import System
from System.Collections.Generic import *

clr.AddReference('ProtoGeometry')
from Autodesk.DesignScript.Geometry import *

clr.AddReference("RevitNodes")
import Revit
clr.ImportExtensions(Revit.Elements)
clr.ImportExtensions(Revit.GeometryConversion)
clr.AddReference("RevitServices")
import RevitServices
from RevitServices.Persistence import DocumentManager 
from RevitServices.Transactions import TransactionManager 

clr.AddReference("RevitAPI")
clr.AddReference("RevitAPIUI")

import Autodesk 
from Autodesk.Revit.DB import *
from Autodesk.Revit.UI import *

doc = DocumentManager.Instance.CurrentDBDocument
uiapp = DocumentManager.Instance.CurrentUIApplication 
app = uiapp.Application 
uidoc = uiapp.ActiveUIDocument

def tolist(obj1):
	if isinstance(obj1,(list, tuple, set)): return obj1
	else: return [obj1]

#Preparing input from dynamo to revit
elements = UnwrapElement(IN[0])
furn = UnwrapElement(IN[1])

#Do some action in a Transaction

TransactionManager.Instance.EnsureInTransaction(doc)

view = doc.ActiveView

#doc.ActiveView.HideCategoryTemporary(ElementId(BuiltInCategory.OST_Walls))


eles = List[ElementId]()
for i in elements:
    eles.Add(i.Id)


#view.HideElements (eles)

"""
public void SetCategoryOverrides(
    ElementId categoryId,
    OverrideGraphicSettings overrideGraphicSettings
)"""

wallCatId = ElementId(BuiltInCategory.OST_Walls)

ovr = OverrideGraphicSettings()

color = Color(255,0,0)
ovr.SetCutLineColor(color)


#view.SetCategoryOverrides(wallCatId, ovr)


view.CropBox = furn.get_BoundingBox(None)

TransactionManager.Instance.TransactionTaskDone()

OUT = furn.get_BoundingBox(None)
# ----------------------------------------
